# Grasshopper definition calc logic baseline - AB.gh (Grasshopper 1.0.7)

year_of_construction = Integer()
ss = Number()
s1 = Number("0.6")
sms = Number()
ie = Number(1)
sm1 = Number()
sds = Number("1.2")
sfrs = Text()
height_ft = Number("295")
sd1 = Number("1")
lat = Number()
long = Number()
tl = Integer("12")
codes = Integer([1961, 1964, 1967, 1970, 1973, 1976, 1979, 1982, 1985, 1988, 1991, 1994, 1997, 2005, 2010, 2016, 2022])
larger = LargerThan(FirstNumber="1987", SecondNumber=codes)  # -> LargerThan, OrEqualTo
smaller = SmallerThan(FirstNumber="1987", SecondNumber=codes)  # -> SmallerThan, OrEqualTo
panel = Panel(codes)
cull = CullPattern(List=codes, CullPattern=larger.OrEqualTo)
item = ListItem(List=cull, Index="-1", Wrap=True)
panel_2 = Panel(item)
index = ItemIndex(List=codes, Item=item)

# ---- group: ASCE 7-16
panel_3 = Panel("""SMF
CMF
SEBF
SBRB
OTHER""")
ct = Panel("""0.028
0.016
0.03
0.03
0.02""")
x = Panel("""0.8
0.9
0.75
0.75
0.75""")
r = Panel("""3.5
3
5
8
3.5""")
keysearch = KeyValueSearch(Keys=panel_3, Values=ct, Search="CMF")
keysearch_2 = KeyValueSearch(Keys=panel_3, Values=r, Search="CMF")
keysearch_3 = KeyValueSearch(Keys=panel_3, Values=x, Search="CMF")
num = Number(keysearch_2)
expression = Expression(ct=keysearch, h=height_ft, x=keysearch_3, Expression="ct*(h^x)")
panel_4 = Panel(expression)
python = GhPythonScript(sds=sds, r=num, ie=ie, sd1=sd1, tl=tl, ta=expression, s1=s1)  # -> cs
# ---------- python: Python ----------
__author__ = "ABawiskar"
__version__ = "2023.06.24"

import rhinoscriptsyntax as rs

if (ta<tl):
    cs_max = sd1/(ta*r/ie)
else:
    cs_max = sd1*tl/((ta^2)(r/ie))

cs_min = max(0.01,0.044*sds*ie)

cs = sds/(r/ie)

if (s1>=0.6):
    cs_min = max(cs_min,0.51*s1/(r/ie))

cs = min(max(cs_min, cs),cs_max)
# ---------- end python ----------
panel_5 = Panel(python)

# ----
panel_6 = Panel(index)
filter = StreamFilter(Gate="16", Stream16=python)
panel_7 = Panel(filter)
